# Grasshopper definition Monkey.gh (Grasshopper 1.0.7)
# plug-ins: Monkey, Human

path_simplify = MK_PathSimplify()  # -> filename, fullname
# ---------- path_simplify: Python ----------
import rhinoscriptsyntax as rs
from System.IO import File, Directory, Path

if source is not None:
    fullname = Path.GetFileName(source)

    lst = fullname.split(".")
    filename = lst[0]
# ---------- end path_simplify ----------
here = MK_Here()  # -> fPath; inputs OpenDir: Boolean
# ---------- here: C# usings ----------
using System.IO;
using System.Diagnostics;
# ---------- here: C# ----------
    GH_Document doc = owner.OnPingDocument();
    string fullPath = doc.FilePath;
    string cleanPath = Path.GetDirectoryName(fullPath);
    string fullName = Path.GetFileName(fullPath);
    string[] fileNames = fullName.Split('.');
    string fileName = fileNames[0];

    string modPath = cleanPath + "/" + fileName;

    if (OpenDir)
    {
      Process.Start(cleanPath);
    }



    fPath = modPath;
# ---------- end here ----------
crv = Curve([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])
file_export = MK_FileExport(file_extension=".fbx", run=False)  # inputs geometries: list of Mesh, ColourToggle: Boolean, run: Boolean
# ---------- file_export: Python ----------
import rhinoscriptsyntax as rs
import scriptcontext
import os
import Rhino
import System
from System.Drawing import Color
import random

scriptcontext.doc = Rhino.RhinoDoc.ActiveDoc

guids = []

if run:
    Rhino.RhinoDoc.ActiveDoc.Objects.UnselectAll()
    for idx, geom in enumerate(geometries):
        attribute = Rhino.DocObjects.ObjectAttributes()
        if ColourToggle:
            random.seed(idx)
            mat = Rhino.DocObjects.Material()
            mat.DiffuseColor = Color.FromArgb(random.randint(0,255), random.randint(0,255), random.randint(0,255))
            mat.Name = "Mat{i}".format(i=idx)
            
            mat_index = scriptcontext.doc.Materials.Add(mat)
            
            attribute.MaterialSource = Rhino.DocObjects.ObjectMaterialSource.MaterialFromObject
            attribute.MaterialIndex = mat_index
        guid = Rhino.RhinoDoc.ActiveDoc.Objects.Add(geom, attribute)
        guids.append(guid)
        rhobj = Rhino.RhinoDoc.ActiveDoc.Objects.Find(guid)
        rhobj.Select(True)
        
    
    filepath = directory + "\\" + filename + file_extension
    if not System.IO.Directory.Exists(directory):
        System.IO.Directory.CreateDirectory(directory)
    
    cmd = "_-Export " + "\"" + filepath + "\"" + " _Enter _Enter"
    
    Rhino.RhinoApp.RunScript(cmd, False)
    for guid in guids:
        Rhino.RhinoDoc.ActiveDoc.Objects.Delete(guid, True)
# ---------- end file_export ----------
file_find = MK_FileFind()  # -> source; inputs Sub: Boolean
# ---------- file_find: Python ----------
import rhinoscriptsyntax as rs
from System.IO import Directory, Path, SearchOption

# default value
if Pat is None:
    Pat = ""

if Dir is not None:
    # search for all pattern
    pat = "{p}*".format(p=Pat)

    # get file, determind sub folder or not
    files = Directory.GetFiles(Dir, pat, SearchOption.TopDirectoryOnly)
    if Sub:
        files = Directory.GetFiles(Dir, pat, SearchOption.AllDirectories)


    source = files
# ---------- end file_find ----------
file_move = MK_FileMove()  # inputs Copy: Boolean, Overwrite: Boolean
# ---------- file_move: Python ----------
import rhinoscriptsyntax as rs
from System.IO import Path, Directory, File
import os

if run is None:
    run = False
if Copy is None:
    Copy = False
if Overwrite is None:
    Overwrite = False

if run:

    if not Directory.Exists(Folder):
        Directory.CreateDirectory(Folder)
    newPath = Folder + Path.GetFileName(source)
    File.Copy(source, newPath, Overwrite)
    if not Copy:
        os.remove(source)
# ---------- end file_move ----------
textwriter = MK_TextWriter()
# ---------- textwriter: Python ----------
import rhinoscriptsyntax as rs
import System

ext = '.txt'

if not System.IO.Directory.Exists(path):
        System.IO.Directory.CreateDirectory(path)

if Run:
    full_path = path + "\\" + fname + ext
    with open(full_path, 'w') as file:
        file.write(Content)
# ---------- end textwriter ----------
attributes = SimulationAttributes(Interval=Slider(20, range=0..100), MaxStep=Slider(200, range=0..1000))
loft = Loft(Curves=crv, Options={Adjust=False, Closed=False, LoftEnds=0, LoftSimp=0, LoftType=0, Rebuild=10, Refit=0.01})
pt = Point(Point(-7.147788484, -23.50705651, 0))
crv_2 = Curve(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)
list = ValueList({"Text File": ".txt", "CSV File": ".csv", "JSON File": ".json", "YAML File": ".yml", "Autodesk FBX (.fbx)": ".fbx", "Wavefront OBJ (.obj)": ".obj", "Rhino 3D Model (.3dm)": ".3dm", "Stereolithography (.stl)": ".stl", "3D Studio (.3ds)": ".3ds", "Collada (.dae)": ".dae", "JPEG Image": ".jpg", "PNG Image": ".png", "GIF Image": ".gif", "MP3 Audio": ".mp3", "WAV Audio": ".wav", "OGG Audio": ".ogg"}, selected="Text File")
rectangle = Rectangle(Plane=PlaneXY(0, 0, 0), XSize=Domain(-1, 1), YSize=Domain(-2, 2), Radius=0)  # -> Rectangle, Length
list_2 = ValueList({"Autodesk FBX (.fbx)": ".fbx", "Wavefront OBJ (.obj)": ".obj", "Rhino 3D Model (.3dm)": ".3dm", "Stereolithography (.stl)": ".stl", "3D Studio (.3ds)": ".3ds", "Collada (.dae)": ".dae"}, selected="Autodesk FBX (.fbx)")
dla = DLACrawl(
    Geo=loft,
    Point=pt,
    AttractorCurve=crv_2,
    SimulationAttribute="{ \"interval\": 10, \"maxStep\": 200 }",
    Scale=1,
    AttractorWeight=0.1)
path = CreatePath(FileExtension=list)
boxrec = BoxRectangle(Rectangle=rectangle.Rectangle, Height=Slider(20, range=0..100))
panel = Panel("E:\02-school\02-Master of Architecture\2023\sem1\PP1\Lecture\test")
path_2 = CreatePath(FileExtension=list_2)
series = Series(Start=0, Step=1, Count=10)
toggle = BooleanToggle(True)
toggle_2 = BooleanToggle(False)
list_3 = ValueList({"Text File": ".txt", "CSV File": ".csv", "JSON File": ".json", "YAML File": ".yml"}, selected="Text File")
Y = UnitY(Factor=series)
export = FileExport(Path=path_2, Bind=True, Run=False)
visualizer = DLAVisualzier(DLALines=dla)  # -> Parameters, Thickness
depath = DeconstructPath()  # -> Directory, Filename, FileExtension
list_4 = ValueList({"Autodesk FBX (.fbx)": ".fbx", "Wavefront OBJ (.obj)": ".obj", "Rhino 3D Model (.3dm)": ".3dm", "Stereolithography (.stl)": ".stl", "3D Studio (.3ds)": ".3ds", "Collada (.dae)": ".dae"}, selected="Autodesk FBX (.fbx)")
move = Move(Geometry=boxrec, Motion=Y)  # -> Geometry, Transform
path_3 = CreatePath(Directory=panel, Filename="test", FileExtension=list_3)
file_move_2 = FileMove(Overwrite=False, Copy=True, Run=False)
gradient = Gradient(
    LowerLimit=0,
    UpperLimit=1,
    Parameter=visualizer.Parameters,
    stops=[0: RGB(0, 98, 0), 0.25: RGB(81, 175, 17), 0.5: RGB(159, 198, 146), 0.75: RGB(170, 235, 41), 1: RGB(221, 255, 53)])
write = FileWrite(Content=panel, Path=path_3, Write=Button())
search = FileSearch(Pattern="*.*", Subfolder=False)
path_4 = CreatePath(FileExtension=list_4)
panel_2 = Panel(write)
here_2 = Here()  # -> FolderPath, Directory, ScriptPath
export_2 = FileExport(Path=path_4, Bind=True, Run=False)
previewlw = CustomPreviewLineweights(Geometry=dla, Shader=gradient, Thickness=visualizer.Thickness, Absolute=False)
